vi "Alamouti_RX_student.gvi"   [LabVIEW NXG]
inputs:
  "Modulation Parameters In": T6 = {"Modulation Type"="QPSK", "Control Information\nfor Packet Header/Tail"={"Training Sequence 1 (derived)"=[], "Zero Pad Length"=0, "Training Sequence 2 (derived)"=[]}, "RX Oversample Factor"=20, "Synchronization Options"={"Synchronization Method"="Timing Estimation", "Fixed Offset"=0, "Symbol Timing Recovery Method"="Max Energy", "Frame Detection Method"="Sliding Correlator", "Correct Frequency Offset"=FALSE}, "Number of Data Symbols (Derived)"=250, "RX Sample Rate"=4000000, "Pulse Shaping Parameters"={"Modulation Type"="PSK", "Pulse Shaping Filter"="Raised Cosine", "Filter Parameter"=0.5, "Filter Length (Symbols)"=8}, "Channel Estimation/Equalization Parameters"={"Equalization Method"="Direct", "Channel Estimate Length"=4, "Equalizer Length"=4, "Equalizer Delay"=-1}}
  "Input Complex Symbols 1": c128[]
  "Input Complex Symbols 2": c128[]
  "Channel estimates": T7
  "error in (no error)": error
outputs:
  "Output Complex Symbols": c128[]
  "Modulation Parameters Out": T6
  "error out": error
types:
  T1 = cluster{"Training Sequence 1 (derived)": c128[], "Zero Pad Length": i32, "Training Sequence 2 (derived)": c128[]}
  T2 = cluster{"Synchronization Method": string, "Fixed Offset": i32, "Symbol Timing Recovery Method": string, "Frame Detection Method": string, "Correct Frequency Offset": bool}
  T3 = enum{"none", "Raised Cosine", "Root Raised Cos", "Gaussian"}
  T4 = cluster{"Modulation Type": enum{"FSK", "PSK", "QAM", "MSK", "PAM", "ASK"}, "Pulse Shaping Filter": T3, "Filter Parameter": f64, "Filter Length (Symbols)": i32}
  T5 = cluster{"Equalization Method": string, "Channel Estimate Length": i32, "Equalizer Length": i32, "Equalizer Delay": i32}
  T6 = cluster{"Modulation Type": string, "Control Information\nfor Packet Header/Tail": T1, "RX Oversample Factor": i32, "Synchronization Options": T2, "Number of Data Symbols (Derived)": i32, "RX Sample Rate": f64, "Pulse Shaping Parameters": T4, "Channel Estimation/Equalization Parameters": T5}
  T7 = cluster{"Element 1": c128[], "Element 2": c128[], "Element 3": c128[], "Element 4": c128[]}
diagram:
  Property Node(instance in=$"Channel estimates") -> ("Element 1"=w1, "Element 2"=w2, "Element 3"=w3, "Element 4"=w4)
  # a0[k]
  Absolute Value(x=w1) -> w5
  Square(x=w5) -> w6
  # a1[k]
  Absolute Value(x=w2) -> w7
  Square(x=w7) -> w8
  Absolute Value(x=w3) -> w9
  # a2[k]
  Square(x=w9) -> w10
  Absolute Value(x=w4) -> w11
  # a3[k]
  Square(x=w11) -> w12
  Add(w6, w8, w10, w12) -> w13
  Array Size(array=$"Input Complex Symbols 1") -> (size(s)=w14)
  Divide(x=w14, y=2) -> w15
  Divide(x=w14, y=64) -> w16
  Reshape Array(inArray=$"Input Complex Symbols 1", size=w16, size=64) -> w17
  for (N = w16) (iteration -> i1) {
    Multiply(2, i1) -> w20
    Array Index(array=w17) -> (out0[w20, _]=w21)
    Multiply(2, i1) -> w22
    Increment(x=w22) -> w23
    Array Index(array=w17) -> (out0[w23, _]=w24)
    append w21 to w18
    append w24 to w19
  }
  # R2[k], R6[k]
  Reshape Array(inArray=w19, size=w15) -> w25
  # R0[k],R4[k]
  Complex Conjugate(x + iy=w25) -> w26
  Array Size(array=w26) -> (size(s)=w27)
  Divide(x=w27, y=64) -> w28
  call "Repeat.gvi"(Array=w2, Numeric=w28) -> (output array=w29)
  Multiply(w29, w26) -> w30
  Array Size(array=$"Input Complex Symbols 2") -> (size(s)=w31)
  Divide(x=w31, y=2) -> w32
  Divide(x=w31, y=64) -> w33
  Reshape Array(inArray=$"Input Complex Symbols 2", size=w33, size=64) -> w34
  for (N = w33) (iteration -> i2) {
    Multiply(2, i2) -> w37
    Array Index(array=w34) -> (out0[w37, _]=w38)
    Multiply(2, i2) -> w39
    Increment(x=w39) -> w40
    Array Index(array=w34) -> (out0[w40, _]=w41)
    append w41 to w35
    append w38 to w36
  }
  Reshape Array(inArray=w36, size=w32) -> w42
  # H1[k]*
  # H2[k]*
  Complex Conjugate(x + iy=w3) -> w43
  Array Size(array=w42) -> (size(s)=w44)
  Divide(x=w44, y=64) -> w45
  call "Repeat.gvi"(Array=w43, Numeric=w45) -> (output array=w46)
  Multiply(w46, w42) -> w47
  # R1[k],R5[k]
  Reshape Array(inArray=w18, size=w15) -> w48
  # Ho[k]*
  Complex Conjugate(x + iy=w1) -> w49
  Array Size(array=w48) -> (size(s)=w50)
  Divide(x=w50, y=64) -> w51
  call "Repeat.gvi"(Array=w49, Numeric=w51) -> (output array=w52)
  Multiply(w52, w48) -> w53
  # R3[k],R7[k]
  Reshape Array(inArray=w35, size=w32) -> w54
  Complex Conjugate(x + iy=w54) -> w55
  Array Size(array=w55) -> (size(s)=w56)
  Divide(x=w56, y=64) -> w57
  call "Repeat.gvi"(Array=w4, Numeric=w57) -> (output array=w58)
  Multiply(w58, w55) -> w59
  # ~s0,~s2,~s4
  Add(w53, w30, w47, w59) -> w60
  Array Size(array=w26) -> (size(s)=w61)
  Divide(x=w61, y=64) -> w62
  call "Repeat.gvi"(Array=w1, Numeric=w62) -> (output array=w63)
  Multiply(w63, w26, -1+0i) -> w64
  # H3[k]*
  Complex Conjugate(x + iy=w4) -> w65
  Array Size(array=w42) -> (size(s)=w66)
  Divide(x=w66, y=64) -> w67
  call "Repeat.gvi"(Array=w65, Numeric=w67) -> (output array=w68)
  Multiply(w68, w42) -> w69
  Array Size(array=w55) -> (size(s)=w70)
  Divide(x=w70, y=64) -> w71
  call "Repeat.gvi"(Array=w3, Numeric=w71) -> (output array=w72)
  Multiply(w72, w55, -1+0i) -> w73
  Complex Conjugate(x + iy=w2) -> w74
  Array Size(array=w48) -> (size(s)=w75)
  Divide(x=w75, y=64) -> w76
  call "Repeat.gvi"(Array=w74, Numeric=w76) -> (output array=w77)
  # ~s1,~s3,~s5
  Multiply(w77, w48) -> w78
  Add(w78, w64, w69, w73) -> w79
  Interleave Array(w60, w79) -> w80
  Divide(x=w80, y=w13) -> w81
  $"Output Complex Symbols" <- w81
  $"error out" <- $"error in (no error)"
  $"Modulation Parameters Out" <- $"Modulation Parameters In"
