vi "receiver_MIMO.gvi"   [LabVIEW NXG]
inputs:
  "HW Parameters In": T1 = {"Active Antenna"="RX1", "Carrier Frequency (Hz)"=915000000, "Gain (dB)"=10, "Trigger Level"=0.01, "Bandwidth (Hz)"=40000000, "Reference Position (%)"=10, "Capture Time (s)"=0.002, "Simulate"=FALSE, "Device IP Address"="192.168.10.2"}
  "Modulation Parameters In": T7 = {"Modulation Type"="QPSK", "Control Information\nfor Packet Header/Tail"={"Training Sequence 1 (derived)"=[], "Zero Pad Length"=0, "Training Sequence 2 (derived)"=[]}, "RX Oversample Factor"=20, "Synchronization Options"={"Synchronization Method"="Timing Estimation", "Fixed Offset"=0, "Symbol Timing Recovery Method"="Max Energy", "Frame Detection Method"="Sliding Correlator", "Correct Frequency Offset"=FALSE}, "Number of Data Symbols (Derived)"=100, "RX Sample Rate"=4000000, "Pulse Shaping Parameters"={"Modulation Type"="PSK", "Pulse Shaping Filter"="Root Raised Cos", "Filter Parameter"=0.5, "Filter Length (Symbols)"=8}, "Channel Estimation/Equalization Parameters"={"Equalization Method"="Direct", "Channel Estimate Length"=1, "Equalizer Length"=1, "Equalizer Delay"=-1}}
  "queue in": cluster{"Key Bit Sequence": Queue<u8[]>}
  "error in (no error)": error
  "Input Complex Waveform 1": cluster{"t0": f64, "dt": f64, "Y": c128[]}
  "OFDM Parameters In": T15 = {"FFT size (N)"=64, "Length of CP (Lc)"=8, "Null Tones"=[0, 30, 31, 32], "Number of OFDM Symbols (derived)"=1, "Training Sequence FFT size"=0, "Training Sequence Length of CP"=0}
  "Input Complex Waveform 2": cluster{"t0": f64, "dt": f64, "Y": c128[]}
outputs:
  "error out": error
  "Modulation Parameters Out": T7
  "HW Parameters Out": T1
  "queue out": cluster{"Key Bit Sequence": Queue<u8[]>}
  "Measured channel impairements": T10
  "Overhead Offset": i32
  "Symbol Rate": f64
  "Bit-Error Rate": f64
  "Offset 1": i32
  "RX Waveforms Out 2": T8
  "RX Waveforms Out 1": T8
  "Received Constellation": T12[]
  "Power delay profiles": T11
  "Offset 2": i32
  "Key Bit Sequence": i8[]
panel controls:
  "Channel Model Parameters": T13 = {"Noise Power (dB)"=-Inf, "Channel Model"="AWGN"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}
  "Training Sequences In": T14 = {"Length 11 Zadoff Chu 1 "=[1+0i, 1+0i, 1+0i, 0+0i, 1+0i, 1+0i, 0+0i, 1+0i, 0+0i, 0+0i, 0+0i], "Length 11 Zadoff Chu 2"=[1+0i, 0+0i, 1+0i, 1+0i, 0+0i, 1+0i, 0+0i, 0+0i, 0+0i, 1+0i, 1+0i]}
panel indicators:
  "Y": c128[]
types:
  T1 = cluster{"Active Antenna": string, "Carrier Frequency (Hz)": f64, "Gain (dB)": f64, "Trigger Level": f64, "Bandwidth (Hz)": f64, "Reference Position (%)": f64, "Capture Time (s)": f64, "Simulate": bool, "Device IP Address": string}
  T2 = cluster{"Training Sequence 1 (derived)": c128[], "Zero Pad Length": i32, "Training Sequence 2 (derived)": c128[]}
  T3 = cluster{"Synchronization Method": string, "Fixed Offset": i32, "Symbol Timing Recovery Method": string, "Frame Detection Method": string, "Correct Frequency Offset": bool}
  T4 = enum{"none", "Raised Cosine", "Root Raised Cos", "Gaussian"}
  T5 = cluster{"Modulation Type": enum{"FSK", "PSK", "QAM", "MSK", "PAM", "ASK"}, "Pulse Shaping Filter": T4, "Filter Parameter": f64, "Filter Length (Symbols)": i32}
  T6 = cluster{"Equalization Method": string, "Channel Estimate Length": i32, "Equalizer Length": i32, "Equalizer Delay": i32}
  T7 = cluster{"Modulation Type": string, "Control Information\nfor Packet Header/Tail": T2, "RX Oversample Factor": i32, "Synchronization Options": T3, "Number of Data Symbols (Derived)": i32, "RX Sample Rate": f64, "Pulse Shaping Parameters": T5, "Channel Estimation/Equalization Parameters": T6}
  T8 = cluster{"Eye Diagram": cluster{"t0": f64, "dt": f64, "Y": f64[]}[], "Power Delay Profile 1": DoubleAnalogWaveform, "IQ Graph": cluster{"Element 1": f64[], "Element 2": f64[]}[], "Power Delay Profile 2": DoubleAnalogWaveform}
  T9 = cluster{"Element 1": c128[], "Element 2": c128[], "Element 3": c128[], "Element 4": c128[]}
  T10 = cluster{"SNR(dB)": f64, "freq. offset 1": f64, "delay 1": f64, "Channel estimates": T9, "freq. offset 2": f64, "delay 2": f64}
  T11 = cluster{"Element 1": DoubleAnalogWaveform, "Element 2": DoubleAnalogWaveform, "Element 3": DoubleAnalogWaveform, "Element 4": DoubleAnalogWaveform}
  T12 = cluster{"constellation": f64[], "oversampled data": f64[]}
  T13 = cluster{"Noise Power (dB)": f64, "Channel Response h_11": c128[], "Frequency Offset": f64, "Delay (sec)": f64, "Channel Model": string, "Channel Response h_12": c128[], "Channel Response h_21": c128[], "Channel Response h_22": c128[]}
  T14 = cluster{"Length 11 Zadoff Chu 1 ": c128[], "Length 11 Zadoff Chu 2": c128[]}
  T15 = cluster{"FFT size (N)": i32, "Length of CP (Lc)": i32, "Null Tones": u32[], "Number of OFDM Symbols (derived)": i32, "Training Sequence FFT size": i32, "Training Sequence Length of CP": i32}
  T16 = cluster{"Training Sequence Type": string, "Training Sequence (derived)": c128[], "Zero Pad Length": i32}
  T17 = cluster{"Control Information\nfor Packet Header/Tail": T16, "RX Oversample Factor": i32, "Synchronization Options": T3, "Number of Data Symbols (Derived)": i32, "RX Sample Rate": f64, "Pulse Shaping Parameters": T5, "Channel Estimation/Equalization Parameters": T6, "Equalize Channel": bool, "Modulation Type": string}
diagram:
  $"HW Parameters Out" <- $"HW Parameters In"
  w1 = T17 {"Control Information\nfor Packet Header/Tail"={"Training Sequence Type"="IEEE 802.11a Short", "Training Sequence (derived)"=[], "Zero Pad Length"=0}, "RX Oversample Factor"=20, "Synchronization Options"={"Synchronization Method"="Timing Estimation", "Fixed Offset"=0, "Symbol Timing Recovery Method"="Max Energy", "Frame Detection Method"="Sliding Correlator", "Correct Frequency Offset"=FALSE}, "Number of Data Symbols (Derived)"=100, "RX Sample Rate"=4000000, "Pulse Shaping Parameters"={"Modulation Type"="PSK", "Pulse Shaping Filter"="Root Raised Cos", "Filter Parameter"=0.5, "Filter Length (Symbols)"=8}, "Channel Estimation/Equalization Parameters"={"Equalization Method"="Direct", "Channel Estimate Length"=1, "Equalizer Length"=1, "Equalizer Delay"=-1}, "Equalize Channel"=FALSE, "Modulation Type"="QPSK"}
  case ($"error in (no error)") {
    frame No Error {
      # 1.Determine the number of data symbols, the symbol rate, the overhead
      # offset, and get the key bit sequence and training sequence from the queue
      Property Node(instance in=$"Input Complex Waveform 1") -> ("Y"=w5)
      $Y <- w5
      call "Training_sequence_preprocessing.gviprotected"(Training Sequences in=$"Training Sequences In", error in (no error)=$"error in (no error)") -> (Training Sequences out=w6, error out=w7)
      call "receiver_init (SubVI).gvi"(Modulation Parameters In=$"Modulation Parameters In", queue in=$"queue in", error in=w7, Training Sequences=w6) -> (Modulation Parameters Out=w8, queue out=w4, symbol rate=w9, key bit sequence=w10, overhead offset=w11, error out=w12)
      call "matched_filtering_MIMO.gviprotected"(Modulation Parameters In=w8, Input Complex Waveform 1=$"Input Complex Waveform 1", Input Complex Waveform 2=$"Input Complex Waveform 2", error in (no error)=w12) -> (Modulation Parameters Out=w13, Output Complex Waveform 1=w14, Output Complex Waveform 2=w15, error out=w16)
      call "synchronize_MIMO.gvi"(Modulation Parameters In=w13, Input Complex Waveform 1=w14, Input Complex Waveform 2=w15, error in (no error)=w16) -> (Modulation Parameters Out=w17, Output Complex Symbols 1=w18, Intermediate Complex Waveform 2=w19, Offset 1=w20, error out=w21, Intermediate Complex Waveform 1=w22, Estimated Frequency Offset 1=w23, Output Complex Symbols 2=w24, Offset 2=w25, Estimated Frequency Offset 2=w26)
      call "channel_estimate_MIMO_student.gvi"(Modulation Parameters In=w17, Input Symbol Sequence 1=w18, Input Symbol Sequence 2=w24, error in (no error)=w21) -> (Modulation Parameters Out=w27, Channel estimates=w28, Mean-Square Error=w29, error out=w30)
      call "receiver_channel_impairments_MIMO (SubVI).gvi"(Modulation Parameters In=w27, mean-squared error=w29, Channel estimates=w28, offset 1=w20, estimated frequency offset 1=w23, offset 2=w25, overhead offset=w11, estimated frequency offset 2=w26) -> (Measured channel impairements=w31)
      call "strip_control_MIMO.gvi"(Modulation Parameters In=w27, input 1=w18, input 2=w24, error in (no error)=w30) -> (Modulation Parameters Out=w32, data symbols 1=w33, data symbols 2=w34, error out=w35)
      # 1.Determine the number of data symbols and get the key bit sequence and training sequence from the queue
      # 2. Process baseband signal
      # 3. Plot the symbol constellation and eye diagram for recovered symbols
      # 2. Process baseband signal
      call "OFDM_demodulator.gviprotected"(Modulation Parameters In=w1, Received Samples=w33, OFDM Parameters in=$"OFDM Parameters In", channel estimate=c128[] []) -> (Demodulated Symbols=w36)
      call "OFDM_demodulator.gviprotected"(Modulation Parameters In=w1, Received Samples=w34, OFDM Parameters in=$"OFDM Parameters In", channel estimate=c128[] []) -> (Demodulated Symbols=w37)
      call "Alamouti_RX_student.gvi"(Modulation Parameters In=w32, Input Complex Symbols 1=w36, Input Complex Symbols 2=w37, Channel estimates=w28, error in (no error)=w35) -> (Output Complex Symbols=w38, Modulation Parameters Out=w39, error out=w40)
      call "decode.gviprotected"(Modulation Parameters In=w39, input symbols=w38, error in (no error)=w40) -> (Modulation Parameters Out=w41, decoded bit stream=w42, error out=w43)
      # 3. Plot the symbol constellation and eye diagram for recovered symbols
      # recovered symbols
      call "receiver_generate_waveforms (SubVI).gvi"(Modulation Parameters In=w41, Intermediate Complex Waveform 1=w22, Data Symbols=w38, Measured channel impairements=w31, Intermediate Complex Waveform 2=w19) -> (Modulation Parameters Out=w3, RX Waveforms Out 1=w44, Power delay profiles=w45, RX Waveforms Out 2=w46, Received Constellation=w47)
      $"RX Waveforms Out 1" <- w44
      $"Symbol Rate" <- w9
      $"RX Waveforms Out 2" <- w46
      $"Received Constellation" <- w47
      $"Power delay profiles" <- w45
      # key bit sequence
      $"Offset 1" <- w20
      call "error_detect.gvi"(input bit sequence=w42, key bit sequence=w10, error in (no error)=w43) -> (bit-error rate=w48, error out=w2)
      $"Bit-Error Rate" <- w48
      $"Offset 2" <- w25
      $"Key Bit Sequence" <- w10
      $"Overhead Offset" <- w11
      $"Measured channel impairements" <- w31
    }
    frame Error {
      w2 = $"error in (no error)"
      w3 = $"Modulation Parameters In"
      w4 = $"queue in"
    }
  }
  $"Modulation Parameters Out" <- w3
  $"error out" <- w2
  $"queue out" <- w4
